# Grasshopper definition ClusterBoxes.gh (Grasshopper 1.0.7)
# plug-ins: CockroachGH

brep = Brep([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])
populatemesh = PopulateMesh(Mesh=brep, N=Slider(110000, range=0..110000), Type=0)
downsamplevoxel = DownsampleVoxel(PointCloud=populatemesh, VoxeSize=Slider(1, range=0..1))
cloudmerge = CloudMerge(PointCloud=downsamplevoxel)
cloudcluster = CloudCluster(PointCloud=cloudmerge, RefPointCloud=cloudmerge, Radius=Slider(2, range=0..2), Neigbhours=0, Split=False)
