# Grasshopper definition ClusterCilantro.gh (Grasshopper 1.0.7)
# plug-ins: CockroachGH

mesh = Mesh(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)
scale = Scale(Geometry=mesh, Center=Point(0, 0, 0), Factor=Slider(0.01, range=0.0001..1))  # -> Geometry, Transform
populatemesh = PopulateMesh(Mesh=mesh, N=Slider(5000, range=0..10000), Type=0)
normals = CloudNormals(PointCloud=populatemesh, Radius=1, Iter=30, Neigbhours=10, D=1, Erase=invert(True))
cloudclustercilantro = CloudClusterCilantro(
    PointCloud=normals,
    VoxelSizeSearch=Slider(0.1, range=0..0.1),
    NormalThresholdDegree=Slider(5, range=0..10),
    MinClusterSize=Slider(100, range=0..100),
    ColorPointCloud=True,
    Split=Toggle(True))
panel = Panel(cloudclustercilantro)
