# Grasshopper definition Downsample.gh (Grasshopper 1.0.7)
# plug-ins: CockroachGH

brep = Brep(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)
populatemesh = PopulateMesh(Mesh=brep, N=Slider(10000, range=0..10000), Type=0)
clo = Cloud(populatemesh)
downsample = Downsample(PointCloud=clo, N=Slider(140112, range=0..1000000))
