# Grasshopper definition MeshBoolean.gh (Grasshopper 1.0.7)
# plug-ins: CockroachGH

list = ValueList({"Difference": 0, "Union": 1, "Intersection": 2}, selected="Difference")
m0 = M(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)
m1 = M1([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])
meshboolean = MeshBoolean(M0=m0, M1=m1, Type=list, Scale=1.001, Color=ColourSwatch(SwatchColor=RGB(176, 0, 0)), Edges=Toggle(True))

# ---- group: For Intersrection You need to joint meshes.
m1_2 = M1([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])  # disabled
m0_2 = M(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)  # disabled
list_2 = ValueList({"Difference": 0, "Union": 1, "Intersection": 2}, selected="Intersection")  # disabled
swatch = ColourSwatch(SwatchColor=RGB(176, 0, 0))  # disabled
toggle = BooleanToggle(True)  # disabled
mjoin = MeshJoin(Meshes=m1_2)  # disabled
meshboolean_2 = MeshBoolean(M0=m0_2, M1=mjoin, Type=list_2, Scale=1.001, Color=swatch, Edges=toggle)  # disabled
