# Grasshopper definition PopulateMesh.gh (Grasshopper 1.0.7)
# plug-ins: CockroachGH, Bifocals

list = ValueList({"Random": 0, "Poisson Disk Sampling": 2}, selected="Random")
mesh = Mesh(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)
populatemesh = PopulateMesh(Mesh=mesh, N=Slider(3000, range=0..100100), Type=list)
panel = Panel(populatemesh)
