# Grasshopper definition SOR.gh (Grasshopper 1.0.7)
# plug-ins: CockroachGH

clo = Cloud(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)
cloudsor = CloudSOR(
    PointCloud=clo,
    Radius=Slider(0, range=0..10),
    Percent=Slider(0, range=0..100),
    Neighbours=Slider(0, range=0..110),
    Type=0)
