# Grasshopper definition Skeleton.gh (Grasshopper 1.0.7)
# plug-ins: CockroachGH

clo = Cloud(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)
downsample = Downsample(PointCloud=clo, N=Slider(5000, range=0..10000))
normals = CloudNormals(PointCloud=downsample, Radius=1, Iter=30, Neigbhours=10, D=Slider(10, range=0..10), Erase=True)
cloudmesh = CloudMesh(PointCloud=normals, Max=8, Min=0, Scale=1.1, Linear=False, Color=False, Open3dCGAL=True)  # -> Mesh, Density
meshskeleton = MeshSkeleton(Mesh=cloudmesh.Mesh)
